# Grasshopper definition RL_Voxel_V1.gh (Grasshopper 1.0.8)
# plug-ins: MeshEdit Components, Cyclops

# ----
# output_steps folder path
panel = Panel("D:\Users\angel\OneDrive\Desktop\IAAC\THESIS\voxelagent1\RL_Voxel-Agent_PPO_V1\output_steps")  # disabled

number_slider = Slider(19, range=0..19)  # disabled
path = FilePath(panel)  # disabled
py3 = Python3Script(path=path, frame=number_slider)  # -> out, a; disabled
# ---------- py3: Python ----------
import Rhino.Geometry as rg
import json
import os

json_file = os.path.join(path, f"step_{int(frame):03}.json")

with open(json_file, 'r') as f:
    data = json.load(f)

voxels = data["voxels"]

boxes = []

grid_size = len(voxels)

for x in range(grid_size):
    for y in range(grid_size):
        for z in range(grid_size):
            if voxels[x][y][z] == 1:
                corner1 = rg.Point3d(x, y, z)
                corner2 = rg.Point3d(x + 1, y + 1, z + 1)
                bbox = rg.BoundingBox(corner1, corner2)
                box = rg.Box(bbox)
                boxes.append(box)

a = boxes
# ---------- end py3 ----------

# ----
# reads voxels, makes boxes
trigger = Trigger(Interval=100, TimerInterval=100, Target=py3_2)
py3_2 = Python3Script()  # -> out, a
# ---------- py3_2: Python ----------
import json
import os
import Rhino.Geometry as rg

path = r"D:\Users\angel\OneDrive\Desktop\IAAC\THESIS\voxelagent1\RL_Voxel-Agent_PPO_V1\temp_voxel_input.json"
boxes = []

if os.path.exists(path):
    with open(path, 'r') as f:
        voxels = json.load(f)["voxels"]

    size = len(voxels)
    for x in range(size):
        for y in range(size):
            for z in range(size):
                if voxels[x][y][z] == 1:
                    pt1 = rg.Point3d(x, y, z)
                    pt2 = rg.Point3d(x + 1, y + 1, z + 1)
                    bbox = rg.BoundingBox(pt1, pt2)
                    boxes.append(rg.Box(bbox))

# Output: list of voxel Boxes
a = boxes
# ---------- end py3_2 ----------
geo = Geometry(graft(py3_2.a))
debrep = DeconstructBrep(Brep=geo)  # -> simplify(Faces), Edges, Vertices
mesh_uv = MeshSurface(Surface=debrep.Faces, UCount="3", VCount="3", Overhang=True, Equalize=False)

# ----
# epw
panel_2 = Panel("https://energyplus-weather.s3.amazonaws.com/europe_wmo_region_6/ESP/ESP_Madrid.082210_IWEC/ESP_Madrid.082210_IWEC.zip")
downloadepw = LBDownloadWeather(weather_URL=panel_2)  # -> epw_file, stat_file, ddy_file; plug-in component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

# ---- group: Create panels
facade_panels = Mesh(mesh_uv)

# ---- group: Specify hemisphere subdivision
subdivision = Subdivision(CyclopsValueList="EqualAreaAspectSubdivision", version="1.0.0.0")
cell_count = Slider(512, range=0..1000)
hemisphere = Hemisphere(CellCount=cell_count, Subdivision=subdivision, method="Hemisphere", version="0.0.0.DevBuild")

# ----
# cyclops analysis
explode = MeshExplode(Mesh=mesh_uv, Interpolate=False)
trim = TrimTree(Tree=explode, Depth=1)
face_normals = FaceNormals(Mesh=facade_panels)  # -> Centers, Normals
G = Geometry(Mesh=mesh_uv, MaterialName="Default Material", Parameter=0, method="Geometry", version="1.0.0.0")
A = AnalysisPoint(Position=face_normals.Centers, Direction=face_normals.Normals, method="Analysis Point", version="1.0.0.0")
analysis_points = CyclopsObject(A, version="0.0.0.DevBuild")
trim_2 = TrimTree(Tree=analysis_points, Depth=1)
hemisphere_2 = Data(hemisphere)

# ---- group: Cyclops geometry
G_2 = GeometryGroup(
    Name="Default Geometry Group",
    Geometry=G,
    VisibilityMask="""{
  "Mask1": true,
  "Mask2": true,
  "Mask3": true,
  "Mask4": true,
  "Mask5": true,
  "Mask6": true,
  "Mask7": true,
  "Mask8": true,
  "BitMap": [
    true,
    true,
    true,
    true,
    true,
    true,
    true,
    true
  ]
}""",
    Transforms={TransformCount=1, Name="Generic", m00=1, m01=0, m02=0, m03=0, m10=0, m11=1, m12=0, m13=0, m20=0, m21=0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},
    IntersectionType="Target",
    method="Geometry Group",
    version="1.0.0.0")

# ---- group: Create sky instance from EPW file
W = Weather(Path=downloadepw.epw_file, NorthVector=Vector(0, 1, 0), LuminousEfficacyModel="MeasuredIlluminance", version="1.0.0.0")
fytp = FullYear(TimeStep=1, version="1.0.0.0")
ss = SkySeries(
    Weather=W,
    Hemisphere=hemisphere_2,
    TimePattern=fytp,
    LuminanceDistributionModel="CIEStandardSkyModel",
    version="1.0.0.0")

# ---- group: Create shading masks for each analysis point
scene_objects = CyclopsObject(G_2, version="0.0.0.DevBuild")
hemisphere_3 = Data(hemisphere)
analysis_points_2 = CyclopsObject(trim_2, version="0.0.0.DevBuild")
number_slider_2 = Slider(200, range=0..1000)

# ----
do = DirectOnly(Samples=number_slider_2, version="1.0.0.0")

# ---- group: Create shading masks for each analysis point (continued)
sma = ShadingMaskAnalysis(
    Run=Toggle(True),
    SceneObjects=scene_objects,
    AnalysisPoints=analysis_points_2,
    Hemisphere=hemisphere_3,
    SamplingSettings=do,
    VisibilityMask="""{
  "Mask1": true,
  "Mask2": true,
  "Mask3": true,
  "Mask4": true,
  "Mask5": true,
  "Mask6": true,
  "Mask7": true,
  "Mask8": true,
  "BitMap": [
    true,
    true,
    true,
    true,
    true,
    true,
    true,
    true
  ]
}""",
    version="1.0.0.0")  # -> Scene, ShadingMasks

# ---- group: Run cumulative solar radiation analysis
radiation_analysis = CumulativeRadiation(ShadingMasks=sma.ShadingMasks, SkySeries=ss, method="Cumulative Radiation", version="0.0.0.DevBuild")  # -> CumulativeRadiation, AverageIrradiance

# ---- group: Visualize analysis results on facade panels
analysis_results = Number(simplify(radiation_analysis.CumulativeRadiation))
facade_panels_2 = Geometry(trim)
gradient = Gradient(
    LowerLimit=0,
    UpperLimit=Slider(700, range=0..1000),
    Parameter=analysis_results,
    stops=[0: RGB(75, 107, 169), 0.25: RGB(173, 203, 249), 0.5: RGB(254, 244, 84), 0.75: RGB(234, 126, 0), 1: RGB(234, 38, 0)])
mesh_colours = MeshColours(Mesh=graft(facade_panels_2), Colours=graft(gradient))

# ----
# cumulative radiation per voxel
ma = MassAddition(Input=analysis_results)  # -> Result, PartialResults
data = Data(flatten(ma.Result))

# ----
# write radiation metric as temp reward
py3_3 = Python3Script(metrics=data)  # -> out, a; inputs metrics: list
# ---------- py3_3: Python ----------
import json
import os
from itertools import chain

# 🔧 Hardcoded base path
base_path = r"D:\Users\angel\OneDrive\Desktop\IAAC\THESIS\voxelagent1\RL_Voxel-Agent_PPO_V1"
output_file = os.path.join(base_path, "temp_reward.json")

# 🧹 Flatten the input (handles both trees and flat lists)
try:
    flat_metrics = list(chain.from_iterable(metrics))  # If it's a tree (e.g. [[val], [val], ...])
except TypeError:
    flat_metrics = metrics  # Already flat

# ✅ Write reward if valid numbers
if flat_metrics and all(isinstance(val, (int, float)) for val in flat_metrics):
    total_reward = sum(flat_metrics)

    with open(output_file, 'w') as f:
        json.dump({"reward": float(total_reward)}, f)
# ---------- end py3_3 ----------
