# Grasshopper definition RL_Voxel_V6_hops.ghx (Grasshopper 1.0.8)
# plug-ins: Karamba3D, opennest_2 Info, Cyclops

panel = Panel("""{"voxels": [[[1, 1, 0, 1, 1], [1, 0, 1, 1, 0], [1, 1, 1, 1, 1], [1, 1, 1, 1, 0], [0, 1, 0, 0, 0]], [[0, 1, 0, 0, 1], [1, 0, 0, 1, 
0], [1, 1, 1, 0, 1], [1, 0, 1, 1, 0], [0, 1, 1, 0, 0]], [[0, 1, 1, 0, 1], [1, 1, 1, 1, 0], [0, 1, 1, 0, 0], [1, 0, 1, 1, 0], [0,  
0, 1, 0, 0]], [[1, 1, 0, 0, 0], [0, 1, 1, 0, 0], [1, 1, 0, 0, 0], [0, 1, 1, 0, 0], [1, 1, 0, 0, 0]], [[1, 1, 0, 0, 0], [0, 1, 1,  
0, 0], [1, 1, 0, 0, 0], [0, 1, 1, 0, 0], [1, 1, 0, 0, 0]]]}""")
voxel_json = GetString(panel, AtLeast=1, AtMost=1, Prompt="json string of voxel positions", TreeAccess=True)
py3 = Python3Script(voxels_json=voxel_json)  # -> out, a; inputs voxels_json: String
# ---------- py3: Python ----------
# venv: lichen
import Rhino.Geometry as rg
import json

voxels = json.loads(voxels_json)['voxels']
boxes = []
print(voxels)
size = len(voxels)
for x in range(size):
    for y in range(size):
        for z in range(size):
            if voxels[x][y][z] == 1:
                pt1 = rg.Point3d(x, y, z)
                pt2 = rg.Point3d(x + 1, y + 1, z + 1)
                bbox = rg.BoundingBox(pt1, pt2)
                boxes.append(rg.Box(bbox))

# Output: list of voxel Boxes
a = boxes
# ---------- end py3 ----------

# ----
# reads voxels, makes boxes
geo = Geometry(graft(py3.a))
debrep = DeconstructBrep(Brep=geo)  # -> simplify(Faces), Edges, Vertices
mesh_uv = MeshSurface(Surface=debrep.Faces, UCount="3", VCount="3", Overhang=True, Equalize=False)

# ----
# karamba
# cull dupes & seperate
debrep_2 = DeconstructBrep(Brep=geo)  # -> Faces, Edges, Vertices
evalsrf = EvaluateSurface(Surface=reparameterize(debrep_2.Faces), Point="0.5,0.5")  # -> Point, Normal, UDirection, VDirection, Frame
devec = DeconstructVector(Vector=evalsrf.Normal)  # -> XComponent, YComponent, ZComponent
equals = Equality(FirstNumber=devec.ZComponent, SecondNumber="0")  # -> Equality, Inequality
dispatch = Dispatch(List=debrep_2.Faces, DispatchPattern=equals.Equality)  # -> flatten(ListA), flatten(ListB)
pcen = PolygonCenter(Polyline=dispatch.ListA)  # -> CenterV, CenterE, CenterA
pcen_2 = PolygonCenter(Polyline=dispatch.ListB)  # -> CenterV, CenterE, CenterA
cullpt = CullDuplicates(Points=pcen.CenterV, Tolerance=0.1, CullMode=1)  # -> Points, Indices, Valence
cullpt_2 = CullDuplicates(Points=pcen_2.CenterV, Tolerance=0.1, CullMode=1)  # -> Points, Indices, Valence
item = ListItem(List=dispatch.ListB, Index=cullpt_2.Indices, Wrap=True)
item_2 = ListItem(List=dispatch.ListA, Index=cullpt.Indices, Wrap=True)
larger = LargerThan(FirstNumber=cullpt.Valence, SecondNumber="1")  # -> LargerThan, OrEqualTo
dispatch_2 = Dispatch(List=item_2, DispatchPattern=larger.LargerThan)  # -> ListA, ListB

# ----
# i put supports at every vertex of the ground for now idk
debrep_3 = DeconstructBrep(Brep=geo)  # -> Faces, Edges, Vertices
pdecon = Deconstruct(Point=debrep_3.Vertices)  # -> XComponent, YComponent, ZComponent
round = Round(Number=pdecon.ZComponent)  # -> Nearest, Floor, Ceiling
equals_2 = Equality(FirstNumber=round.Nearest, SecondNumber="0")  # -> Equality, Inequality
dispatch_3 = Dispatch(List=debrep_3.Vertices, DispatchPattern=equals_2.Equality)  # -> ListA, ListB
geo_2 = Geometry(flatten(dispatch_3.ListA))
cullpt_3 = CullDuplicates(Points=geo_2, Tolerance=0.1, CullMode=3)  # -> Points, Indices, Valence
supp = SupportKaramba3D(PosInd=cullpt_3.Points, menu=[buttons(on, on, on, on, on, on)])

mesh = Mesh(mesh_uv)

# ---- group: Create panels
facade_panels = Mesh(mesh)

# ---- group: Specify hemisphere subdivision
subdivision = Subdivision(CyclopsValueList="EqualAreaAspectSubdivision", version="1.0.0.0")
# cyclops
cell_count = Slider(512, range=0..1000)
hemisphere = Hemisphere(CellCount=cell_count, Subdivision=subdivision, method="Hemisphere", version="0.0.0.DevBuild")

# ----
txt = Text("C:\gits\RL_Voxel-Agent_PPO_V1\gh_files\epw\ESP_Barcelona.081810_SWEC.epw")

# ----
# horizontal elements
srf = Surface(item)

# ----
# exterior walls
srf_2 = Surface(dispatch_2.ListB)

# ----
# interior walls
srf_3 = Surface(reparameterize(dispatch_2.ListA))

# ----
# horizontal elements
matselect = MaterialSelectionKaramba3D(menu=[dropdown(1), dropdown(7), dropdown(6)])
mesh_breps = MeshBrepsKaramba3D(Brep=srf, MeshResolution=1, EdgeRefinementFactor=0.67, PointReduction=False, SmoothingStepSize=0, SmoothingIterations=5)  # -> Mesh, Info
crosec = CrossSectionKaramba3D(FamilyNameOfCrossSection="DefaultCroSec", Material=matselect, Height_cm="7.5", mode="Shell - Const")
surfelem = CreateSurfaceElementKaramba3D(Mesh=mesh_breps.Mesh, CrossSection=crosec, LimitDistance_m=0.005, Bending=True, mode="MeshToShell")  # -> Element, Points, Info

# ----
# exterior walls
matselect_2 = MaterialSelectionKaramba3D(menu=[dropdown(1), dropdown(5), dropdown(1)])
crosec_2 = CrossSectionKaramba3D(FamilyNameOfCrossSection="DefaultCroSec", Material=matselect_2, Height_cm=Slider(10, range=0..100), mode="Shell - Const")
surfelem_2 = CreateSurfaceElementKaramba3D(Mesh=srf_2, CrossSection=crosec_2, LimitDistance_m=0.005, Bending=True, mode="MeshToShell")  # -> Element, Points, Info

# ----
# interior columns
panel_2 = Panel("0, 0")
iso = IsoCurve(Surface=srf_3, UVPoint=panel_2)  # -> UIsocurve, flatten(VIsocurve)
iso_2 = IsoCurve(Surface=srf_3, UVPoint="1, 0")  # -> UIsocurve, flatten(VIsocurve)
merge = Merge(Data1=iso.VIsocurve, Data2=iso_2.VIsocurve)
crosec_3 = CrossSectionKaramba3D(
    FamilyNameOfCrossSection="DefaultCroSec",
    Height_cm=9.6,
    UpperFlangeWidth_cm=10,
    LowerFlangeWidth_cm=10,
    UpperFlangeThickness_cm=0.8,
    LowerFlangeThickness_cm=0.8,
    WebThickness_cm=0.5,
    FilletRadius_cm=0,
    mode="I")
rdlines = RemoveDuplicateLinesKaramba3D(Line=merge, LimitDistance=0.005)  # -> OutLine, Info, Indexes
lineelem = CreateLinearElementKaramba3D(
    Line=rdlines.OutLine,
    CrossSection=crosec_3,
    LimitDistance_m=0.005,
    BucklingLengthY_m=-1,
    BucklingLengthZ_m=-1,
    BucklingLengthLT_m=-1,
    Bending=True,
    ToPolylineMaxAngle=0.25,
    ToPolylineTolerance=0.1,
    ToPolylineMaxEdgeLength=0.25,
    New=True,
    Remove=True,
    mode="LineToBeam")  # -> Element, Points, Info

panel_3 = Panel("""2
6
3
7""")
panel_4 = Panel("""6
2
7
3""")
faces = Brep(flatten(srf_2))
py3_2 = Python3Script(faces=faces)  # -> out, es, ns, ws, ss; inputs faces: list of Surface
# ---------- py3_2: Python ----------
import Rhino.Geometry as rg

def sort_faces(faces):
    directions = [face.NormalAt(0.5, 0.5) for face in faces]
    easts = [face for face in faces if face.NormalAt(0.5,0.5).X>0]
    norths = [face for face in faces if face.NormalAt(0.5,0.5).Y>0]
    wests = [face for face in faces if face.NormalAt(0.5,0.5).X<0]
    souths = [face for face in faces if face.NormalAt(0.5,0.5).Y<0]

    return easts, norths, wests, souths


es, ns, ws, ss = sort_faces(faces)
# ---------- end py3_2 ----------

# ----
# north faces
north = Surface(py3_2.ns)

# ----
# south faces
south = Surface(py3_2.ss)

# ----
# west faces
west = Surface(py3_2.ws)

# ----
# panelling and waste calcs
# east faces
east = Surface(py3_2.es)

# ----
# all structural elements
merge_2 = Merge(Data1=lineelem.Element, Data2=surfelem_2.Element, Data3=surfelem.Element)  # -> flatten(Result)

# ----
# load cases
panel_5 = Panel("0,0,-5")
loads = LoadsKaramba3D(Vector=Vector(0, 0, -1), LCase="LC0", mode="Gravity")
loads_2 = LoadsKaramba3D(
    Vector=panel_5,
    Mesh=flatten(mesh_breps.Mesh),
    LCase="LC0",
    mode="MeshLoad -Const.",
    menu=[buttons(on, off, off), buttons(on, on)])
merge_3 = Merge(Data1=loads, Data2=loads_2)

# ----
# system symmetry
# (0.33 = 1 axis, 0.66, 2 axes, etc)
py3_3 = Python3Script(boxes=py3.a)  # -> out, simplify(a); inputs boxes: list
# ---------- py3_3: Python ----------
import Rhino
import Rhino.Geometry as rg
import scriptcontext as sc
import System  # ✅ Needed for System.Guid checks

def get_geometry(guids):
    """Convert Rhino GUIDs to geometry objects."""
    geoms = []
    for g in guids:
        obj = sc.doc.Objects.Find(g)  # find the object in the Rhino doc
        if obj: 
            geo = obj.Geometry
            geoms.append(geo)
    return geoms

def get_centers(boxes):
    """Extract the centers of boxes or breps."""
    centers = []
    for b in boxes:
        if isinstance(b, rg.Box):
            centers.append(b.Center)
        elif isinstance(b, rg.Brep):
            bb = b.GetBoundingBox(True)
            centers.append(bb.Center)
        elif isinstance(b, rg.BoundingBox):  
            centers.append(b.Center)
    return centers

def normalize(points):
    """Center all points around origin for easier symmetry checks."""
    xs = [p.X for p in points]
    ys = [p.Y for p in points]
    zs = [p.Z for p in points]
    cx, cy, cz = (sum(xs) / len(xs), sum(ys) / len(ys), sum(zs) / len(zs))
    return [rg.Point3d(p.X - cx, p.Y - cy, p.Z - cz) for p in points]

def symmetry_score(points, axis):
    """Check symmetry across a given axis ('x','y','z')."""
    pts_set = {(round(p.X,3), round(p.Y,3), round(p.Z,3)) for p in points}
    matches = 0
    
    for p in points:
        if axis == 'x':
            mp = (-p.X, p.Y, p.Z)
        elif axis == 'y':
            mp = (p.X, -p.Y, p.Z)
        elif axis == 'z':
            mp = (p.X, p.Y, -p.Z)
        if mp in pts_set:
            matches += 1
    
    return matches / float(len(points))

# -----------------------
# INPUT: boxes (could be GUIDs or geometry)
# OUTPUT: overall symmetry score (0.0 - 1.0)
# -----------------------

if boxes:
    # ✅ Convert GUIDs to geometry if needed
    if isinstance(boxes[0], System.Guid):
        boxes = get_geometry(boxes)

    centers = get_centers(boxes)
    centers = normalize(centers)
    
    score_x = symmetry_score(centers, 'x')
    score_y = symmetry_score(centers, 'y')
    score_z = symmetry_score(centers, 'z')
    
    overall_score = (score_x + score_y + score_z) / 3.0
else:
    overall_score = 0.0

a = overall_score
# ---------- end py3_3 ----------
symmetry_score = Panel(py3_3.a)

# ----
# karamba assembly + analysis
assemble = AssembleModelKaramba3D(Elem=merge_2, Support=supp, Load=merge_3, LimitDistance_m=0.005)  # -> Model, Info, Mass_kg, CentreOfGravity, LoadCaseNames
analyse_analyze = AnalyseKaramba3D(Model=assemble.Model)  # -> AnalysedModel, MaximumDisplacement_cm, ResultingForce_kN, ChangeOfElasticEnergy_kNm
shellview = ShellViewKaramba3D(Model=analyse_analyze.AnalysedModel, IndexOfLayer=0)  # -> Model, MeshesOfRenderedShells, LegendColours, LegendTags
modelview = ModelViewKaramba3D(Model=analyse_analyze.AnalysedModel, Colours=shellview.LegendColours)  # -> Model, DeformedMesh, DeformedAxes, DeformedModel, MaximumDeformation
legend = Legend(Colour=shellview.LegendColours, Tags=shellview.LegendTags, LegendType=1)  # disabled

rectangle = Rectangle(Plane=PlaneXY(0, 0, 0), XSize=Slider(5, range=0..5), YSize=Slider(3, range=0..5), Radius=0)  # -> Rectangle, Length; disabled

# ----
# reward weights
number_slider = Slider(1, range=0.1..1)
sunhours_weight = Slider(0.5, range=0.1..1)
radiation_weight = Slider(0.5, range=0.1..1)

w_rad = GetNumber(radiation_weight, AtLeast=1, AtMost=1, Maximum=1.797693135e+308, Minimum=-1.797693135e+308, TreeAccess=False)
w_sun = GetNumber(sunhours_weight, AtLeast=1, AtMost=1, Maximum=1.797693135e+308, Minimum=-1.797693135e+308, TreeAccess=False)
w_avg_rad = GetNumber(number_slider, AtLeast=1, AtMost=1, Maximum=1.797693135e+308, Minimum=-1.797693135e+308, TreeAccess=False)
w_sym = GetNumber(Slider(1, range=0.1..1), AtLeast=1, AtMost=1, Maximum=1.797693135e+308, Minimum=-1.797693135e+308, TreeAccess=False)

panel_6 = Panel("eda37359-7424-4940-a640-33d3095d3f23)")
mesh_2 = Mesh(modelview.DeformedMesh)  # disabled
nodedisp_nodedisp = NodalDisplacementsKaramba3D(AnalysedModel=modelview.Model)  # -> Model, NodalTranslations_m, NodalRotations_rad, DisplacementPosition, LoadCaseIndex
demesh = DeconstructMesh(Mesh=mesh_2)  # -> Vertices, Faces, Colours, Normals; disabled
demesh_2 = DeconstructMesh(Mesh=shellview.MeshesOfRenderedShells)  # -> Vertices, Faces, Colours, Normals; disabled
vlen = VectorLength(Vector=flatten(nodedisp_nodedisp.NodalTranslations_m))
conmesh = ConstructMesh(Vertices=demesh.Vertices, Faces=demesh.Faces, Colours=demesh_2.Colours)  # disabled
sort = SortList(Keys=vlen, ValuesA=vlen)  # -> Keys, ValuesA
item_3 = ListItem(List=sort.ValuesA, Index="-1", Wrap=True)
one_over_x = OneOverX(Value=item_3)
division = Division(A=one_over_x, B=Slider(1000, range=0..1000))
c_bake = ContextBake(Inv_max_displacement=division)
panel_7 = Panel(division)

# ----
# CUMULATIVE RADIATION
G = Geometry(Mesh=flatten(mesh), MaterialName="Default Material", Parameter=0, method="Geometry", version="1.0.0.0")
face_normals = FaceNormals(Mesh=facade_panels)  # -> Centers, Normals
A = AnalysisPoint(Position=face_normals.Centers, Direction=face_normals.Normals, method="Analysis Point", version="1.0.0.0")
analysis_points = CyclopsObject(A, version="0.0.0.DevBuild")
epw_path = GetString(txt, AtLeast=1, AtMost=1, TreeAccess=True)
trim = TrimTree(Tree=analysis_points, Depth=1)
hemisphere_2 = Data(hemisphere)

# ---- group: Cyclops geometry
G_2 = GeometryGroup(
    Name="Default Geometry Group",
    Geometry=G,
    VisibilityMask="""{
  "Mask1": true,
  "Mask2": true,
  "Mask3": true,
  "Mask4": true,
  "Mask5": true,
  "Mask6": true,
  "Mask7": true,
  "Mask8": true,
  "BitMap": [
    true,
    true,
    true,
    true,
    true,
    true,
    true,
    true
  ]
}""",
    Transforms={TransformCount=1, Name="Generic", m00=1, m01=0, m02=0, m03=0, m10=0, m11=1, m12=0, m13=0, m20=0, m21=0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},
    IntersectionType="Target",
    method="Geometry Group",
    version="1.0.0.0")

# ----
txt_2 = Text(epw_path)
panel_8 = Panel(txt_2)

# ---- group: Create sky instance from EPW file
W = Weather(Path=txt_2, NorthVector=Vector(0, 1, 0), LuminousEfficacyModel="MeasuredIlluminance", version="1.0.0.0")
fytp = FullYear(TimeStep=1, version="1.0.0.0")
ss = SkySeries(
    Weather=W,
    Hemisphere=hemisphere_2,
    TimePattern=fytp,
    LuminanceDistributionModel="CIEStandardSkyModel",
    version="1.0.0.0")

# ----
skyseries = Data(ss)

# ---- group: Create shading masks for each analysis point
scene_objects = CyclopsObject(G_2, version="0.0.0.DevBuild")
hemisphere_3 = Data(hemisphere)
analysis_points_2 = CyclopsObject(trim, version="0.0.0.DevBuild")
number_slider_2 = Slider(200, range=0..1000)

# ----
do = DirectOnly(Samples=number_slider_2, version="1.0.0.0")

# ---- group: Create shading masks for each analysis point (continued)
sma = ShadingMaskAnalysis(
    Run=Toggle(True),
    SceneObjects=scene_objects,
    AnalysisPoints=analysis_points_2,
    Hemisphere=hemisphere_3,
    SamplingSettings=do,
    VisibilityMask="""{
  "Mask1": true,
  "Mask2": true,
  "Mask3": true,
  "Mask4": true,
  "Mask5": true,
  "Mask6": true,
  "Mask7": true,
  "Mask8": true,
  "BitMap": [
    true,
    true,
    true,
    true,
    true,
    true,
    true,
    true
  ]
}""",
    version="1.0.0.0")  # -> Scene, ShadingMasks

# ---- group: Run cumulative solar radiation analysis
radiation_analysis = CumulativeRadiation(ShadingMasks=sma.ShadingMasks, SkySeries=skyseries, method="Cumulative Radiation", version="0.0.0.DevBuild")  # -> CumulativeRadiation, AverageIrradiance

# ---- group: Visualize analysis results on facade panels
analysis_results = Number(simplify(radiation_analysis.CumulativeRadiation))

# ----
# maximise sun hours
fytp_2 = FullYear(TimeStep=1, version="1.2.0.60000")
sr = SunRig(
    NorthVector=Vector(0, 1, 0),
    Location="""{
  "Latitude": 51.48,
  "Longitude": 0,
  "Timezone": 0,
  "Country": "United Kingdom",
  "AdminDistrict": "London",
  "AddressLine": "Greenwich"
}""",
    TimePattern=fytp_2,
    CutOffElevation=0,
    method="Sun Rig",
    version="1.2.0.60000")
sha = SunlightHourAnalysis(
    Run=True,
    SceneObjects=scene_objects,
    SunRig=sr,
    AnalysisPoints=analysis_points_2,
    VisibilityMask="""{
  "Mask1": true,
  "Mask2": true,
  "Mask3": true,
  "Mask4": true,
  "Mask5": true,
  "Mask6": true,
  "Mask7": true,
  "Mask8": true,
  "BitMap": [
    true,
    true,
    true,
    true,
    true,
    true,
    true,
    true
  ]
}""",
    method="Sunlight Hour Analysis",
    version="1.2.0.60000")  # -> Scene, SunlightHours

# ----
# cumulative sun hours per voxel
ma = MassAddition(Input=sha.SunlightHours)  # -> Result, PartialResults
data = Data(simplify(ma.Result))

# ----
# cumulative radiation per voxel
ma_2 = MassAddition(Input=analysis_results)  # -> Result, PartialResults
data_2 = Data(simplify(ma_2.Result))

# ----
# avg rad per voxel
data_3 = Data(flatten(ma_2.Result))
lng = ListLength(List=data_3)
ma_3 = MassAddition(Input=data_3)  # -> Result, PartialResults
division_2 = Division(A=ma_3.Result, B=lng)
data_4 = Data(division_2)

# ----
# calculate reward
merge_4 = Merge(Data1=data_2, Data2=data)
py3_4 = Python3Script(metrics=merge_4, avg_rad=data_4, symmetry=py3_3.a, w_rad=w_rad, w_sun=w_sun, w_avg_rad=w_avg_rad, w_sym=w_sym)  # -> out, total_reward; inputs metrics: tree
# ---------- py3_4: Python ----------
import json
import os

# Validate weights
if w_rad is None or w_sun is None:
    print("❌ Missing weight inputs")
    exit()

total_reward = 0.0
valid = True

try:
    for i in range(metrics.BranchCount):
        raw_entry = metrics.Branch(i)
        entry = list(raw_entry)  # ✅ Convert from .NET list to Python list

        if not isinstance(entry, list) or len(entry) < 2:
            print(f"❌ Invalid metric at index {i}: {entry}")
            valid = False
            break

        rad = float(entry[0])
        sun = float(entry[1])
        voxel_reward = (w_rad * rad) + (w_sun * sun)
        total_reward += voxel_reward

except Exception as e:
    print("❌ Error in parsing:", e)
    valid = False
    total_reward = -0.2
# ---------- end py3_4 ----------

division_3 = Division(A=py3_4.total_reward, B=Slider(1000000, range=0..1000000))
panel_9 = Panel(division_3)
c_print = ContextPrint(Daylight_reward=division_3)

cols_max = Slider(6, range=0..10)
cols_min = Slider(0, range=0..1)
rows_max = Slider(7, range=0..10)
rows_min = Slider(0, range=0..1)
cols_max_2 = GetNumber(panel_4, AtLeast=1, AtMost=1, Maximum=1.797693135e+308, Minimum=-1.797693135e+308, TreeAccess=True)
rows_max_2 = GetNumber(panel_3, AtLeast=1, AtMost=1, Maximum=1.797693135e+308, Minimum=-1.797693135e+308, TreeAccess=True)

repeat = RepeatData(Data=rows_min, Length="4")
repeat_2 = RepeatData(Data=cols_min, Length="4")

rows_min_2 = GetNumber(repeat, AtLeast=1, AtMost=1, Maximum=1.797693135e+308, Minimum=-1.797693135e+308, TreeAccess=True)
cols_min_2 = GetNumber(repeat_2, AtLeast=1, AtMost=1, Maximum=1.797693135e+308, Minimum=-1.797693135e+308, TreeAccess=True)
py3_5 = Python3Script(
    Faces=faces,
    cols_min=cols_min_2,
    cols_max=cols_max_2,
    rows_min=rows_min_2,
    rows_max=rows_max_2,
    alpha=Slider(10, range=0..10),
    seed=Slider(7, range=0..10))  # -> tiles, flatten(outlines), metrics_json, signature_raw, preview_crv; inputs Faces: tree of Brep, cols_min: list, cols_max: list, rows_min: list, rows_max: list
# ---------- py3_5: Python ----------
# venv: lichen

import Rhino.Geometry as rg
import rhinoscriptsyntax as rs
import System, random, json


tiles = []
outlines = []
metrics_json = ""
signature_raw = ""
preview_crv = []
signature_tile_params = [] 


def iterate_all(x):
    """Yield every item from a Tree, list, or single value."""
    if x is None:
        return
    try:
        for p in x.Paths:
            for it in x.Branch(p):
                yield it
        return
    except Exception:
        pass
    if hasattr(x, "__iter__") and not isinstance(x, (rg.Brep, rg.Surface, rg.BrepFace, System.Guid)):
        for it in x:
            yield it
        return
    yield x

def faces_from(g):
    """Yield every BrepFace from Brep/Surface/BrepFace/GUID."""
    if isinstance(g, System.Guid):
        b = rs.coercebrep(g)
        if b:
            for f in b.Faces:
                yield f
            return
        s = rs.coercesurface(g)
        if s:
            b = s.ToBrep()
            if b:
                for f in b.Faces:
                    yield f
        return
    if isinstance(g, rg.BrepFace):
        yield g; return
    if isinstance(g, rg.Surface):
        b = g.ToBrep()
        if b:
            for f in b.Faces:
                yield f
        return
    if isinstance(g, rg.Brep):
        for f in g.Faces:
            yield f
        return

def dirichlet_breaks(n, alpha, rnd):
    """Return normalized [0..1] breakpoints (len = n+1) for n segments."""
    if n <= 0:
        return [0.0, 1.0]
    seg = [rnd.gammavariate(alpha, 1.0) for _ in range(n)]
    s = sum(seg) or 1.0
    brk = [0.0]; acc = 0.0
    for w in seg:
        acc += w / s
        brk.append(acc)
    brk[-1] = 1.0
    return brk

def map_norm_to_domain(t, dom):
    """Map normalized t in [0,1] to a Rhino Interval domain (supports reversed)."""
    return dom.T0 + t * (dom.T1 - dom.T0)


def safe_int(v, d): 
    try: return int(v)
    except: return d
def safe_float(v, d):
    try: return float(v)
    except: return d

def sort_faces(faces):
    easts = [face for face in faces if face.NormalAt(0.5,0.5).X>0]
    norths = [face for face in faces if face.NormalAt(0.5,0.5).Y>0]
    wests = [face for face in faces if face.NormalAt(0.5,0.5).X<0]
    souths = [face for face in faces if face.NormalAt(0.5,0.5).Y<0]

    return [easts, norths, wests, souths]

cols_min = [max(1, safe_int(col_min, 3)) for col_min in cols_min]
cols_max = [max(col_min, safe_int(col_max, col_min)) for col_min in cols_min for col_max in cols_max]
rows_min = [max(1, safe_int(row_min, 2)) for row_min in rows_min]
rows_max = [max(row_min, safe_int(row_max, row_min)) for row_max in rows_max for row_min in rows_min]
alpha    = max(0.05, safe_float(alpha, 1.0))
seed     = safe_int(seed, 0)
rnd = random.Random(seed)

allFaces = []
for g in iterate_all(Faces):
    for f in faces_from(g):
        allFaces.append(f)

face_lists = sort_faces(allFaces)

if not allFaces:
    metrics_json = json.dumps({"error":"no faces found"})
else:
    for i in range(4):
        allF = face_lists[i]
        col_min = cols_min[i]
        col_max = cols_max[i]
        row_min = rows_min[i]
        row_max = rows_max[i]
        ncols = rnd.randint(col_min, col_max)
        U_norm = dirichlet_breaks(ncols, alpha, rnd)  # len ncols+1

        V_norm_per_col = []
        rows_per_column = []
        for _ in range(ncols):
            nrows = rnd.randint(row_min, row_max)
            rows_per_column.append(nrows)
            V_norm_per_col.append(dirichlet_breaks(nrows, alpha, rnd))  # each len nrows+1

        for face_id, face in enumerate(allF):
            du, dv = face.Domain(0), face.Domain(1)
            amp_face = rg.AreaMassProperties.Compute(face)
            face_area = amp_face.Area if amp_face else 0.0

            for i in range(ncols):
                u0n, u1n = U_norm[i], U_norm[i+1]
                u0 = map_norm_to_domain(u0n, du)
                u1 = map_norm_to_domain(u1n, du)

                Vn = V_norm_per_col[i]
                nrows_this_col = len(Vn) - 1

                for j in range(nrows_this_col):
                    v0n, v1n = Vn[j], Vn[j+1]
                    v0 = map_norm_to_domain(v0n, dv)
                    v1 = map_norm_to_domain(v1n, dv)


                    cell = face.Trim(rg.Interval(u0, u1), rg.Interval(v0, v1))
                    if cell:
                        tiles.append(cell)
                        # outline for preview
                        p0 = face.PointAt(u0, v0); p1 = face.PointAt(u1, v0)
                        p2 = face.PointAt(u1, v1); p3 = face.PointAt(u0, v1)
                        crv = rg.PolylineCurve([p0, p1, p2, p3, p0])
                        outlines.append(crv)

                        amp = rg.AreaMassProperties.Compute(cell)
                        tile_area = amp.Area if amp else 0.0

                        # numeric row for this tile
                        row = [
                            float(face_id),             
                            float(tile_area),           
                            float(face_area),       
                            float(ncols),              
                            float(nrows_this_col),      
                            float(i),                 
                            float(j),                  
                            float(u0n), float(u1n),    
                            float(v0n), float(v1n)      
                        ]
                        signature_tile_params.append(row)

    areas = []
    for b in tiles:
        amp = rg.AreaMassProperties.Compute(b)
        if amp: areas.append(amp.Area)
    a_min = min(areas) if areas else 0.0
    a_max = max(areas) if areas else 0.0
    a_avg = (sum(areas) / len(areas)) if areas else 0.0
    a_var = (sum((a - a_avg)**2 for a in areas) / len(areas)) if areas else 0.0
    a_std = a_var**0.5

    metrics = {
        "faces_processed": len(allF),
        "tiles": len(tiles),
        "area_min": a_min,
        "area_max": a_max,
        "area_avg": a_avg,
        "area_std": a_std,
        "cols": ncols,
        "rows_per_column": rows_per_column,
        "seed": seed,
        "alpha": alpha
    }
    metrics_json = json.dumps(metrics, separators=(',',':'))

 
    signature_raw_dict = {
        "seed": seed,
        "alpha": alpha,
        "cols": ncols,
        "U_norm": U_norm,                   # column cuts (normalized)
        "V_norm_per_col": V_norm_per_col    # list of row cuts per column (normalized)
    }
    signature_raw = json.dumps(signature_raw_dict, separators=(',',':'))

preview_crv = outlines[:]
# ---------- end py3_5 ----------

# ----
# Grouping panels
# Area with side length
# Perimeter
facade_panels_2 = Curve(py3_5.outlines)
explode = Explode(Curve=facade_panels_2, Recursive=True)  # -> Segments, Vertices
join = JoinCurves(Curves=explode.Segments, Preserve=False)  # -> flatten(Curves)
area = Area(Geometry=facade_panels_2)  # -> Area, Centroid
dim = Dimensions(Surface=join)  # -> UDimension, VDimension
areapanels = Data(area.Area)
u_dim = Data(dim.UDimension)
v_dim = Data(dim.VDimension)
expression = Expression(x=v_dim, y=u_dim, Expression="(x+y)*2")
expression_2 = Expression(x=areapanels, y=v_dim, z=u_dim, Expression="x+(y+z)")
panelperimetersides = Data(expression)
panelareasides = Data(expression_2)

project = Project(Geometry=py3_5.outlines, Plane=PlaneXY(0, 0, 0))  # -> Geometry, Transform
pack = PackObjects(Geo=py3_5.outlines, Plane=project.Transform, X=1, Y=1, Tolerance=0)  # -> Geo, Transformation

# ----
# NESTING
sheets = Sheets(Polylines=rectangle.Rectangle, Gap=0.1)  # -> Sheets, Polylines; disabled
nesting = Python3Script(G=pack.Geo, sheet_w=Slider(5, range=0..10), sheet_h=Slider(3, range=0..10))  # -> out, Packed, flatten(SheetRects), SheetCount; inputs G: list
# ---------- nesting: Python ----------
"""Minimal shelf nesting (no plugins)
Inputs:
  G: list of geometry (Curves/Breps/Meshes)
  sheet_w: float
  sheet_h: float
Outputs:
  Packed: placed geometry copies
  SheetRects: rectangles for each sheet
  SheetCount: number of sheets used
"""

import Rhino.Geometry as rg

def bbox_size_in_plane(geom, plane):
    bb = geom.GetBoundingBox(plane)
    if not bb.IsValid:
        return None, 0.0, 0.0
    w = bb.Max.X - bb.Min.X
    h = bb.Max.Y - bb.Min.Y
    return bb, w, h

# default outputs
Packed = []
SheetRects = []
SheetCount = 0

if G:
    plane = rg.Plane.WorldXY
    W = float(sheet_w)
    H = float(sheet_h)

    parts = [g for g in G if g is not None]
    def area_proxy(g):
        bb, w, h = bbox_size_in_plane(g, plane)
        return 0.0 if bb is None else w*h
    parts.sort(key=area_proxy, reverse=True)

    # first sheet
    SheetRects.append(rg.Rectangle3d(plane, rg.Interval(0, W), rg.Interval(0, H)))

    # shelf cursors (no margins, no spacing, no rotation)
    x = 0.0
    y = 0.0
    row_h = 0.0

    for g in parts:
        bb, w, h = bbox_size_in_plane(g, plane)
        if bb is None:
            continue

        # new row if needed
        if x + w > W + 1e-9:
            x = 0.0
            y = y + row_h
            row_h = 0.0

        # new sheet if needed
        if y + h > H + 1e-9:
            SheetRects.append(rg.Rectangle3d(plane, rg.Interval(0, W), rg.Interval(0, H)))
            x = 0.0
            y = 0.0
            row_h = 0.0

        # place copy
        dx = x - bb.Min.X
        dy = y - bb.Min.Y
        xform = rg.Transform.Translation(dx, dy, 0.0)
        g2 = g.Duplicate()
        g2.Transform(xform)
        Packed.append(g2)

        # advance shelf
        x += w
        if h > row_h:
            row_h = h

    # count sheets
    SheetCount = len(SheetRects)
# ---------- end nesting ----------
panel_10 = Panel(nesting.SheetCount)

# ----
# Group panels based on dimentions
cset = CreateSet(List=panelareasides)  # -> Set, Map
area_with_length_of_groups = Panel(cset.Map)
mappanelgroups = Data(cset.Map)
mindex = MemberIndex(Set=panelareasides, Member=cset.Set)  # -> Index, Count
nr_of_panels_per_group = Panel(mindex.Count)
indexpanelgroups = Data(mindex.Index)
countpanelgroups = Data(mindex.Count)

# ----
# Visualise
mappanelgroups_2 = Data(mappanelgroups)
bnd = Bounds(Numbers=mappanelgroups_2)
dedomain = DeconstructDomain(Domain=bnd)  # -> Start, End
gradient = Gradient(
    LowerLimit=dedomain.Start,
    UpperLimit=dedomain.End,
    Parameter=mappanelgroups_2,
    stops=[0: RGB(0, 255, 255), 0.496: RGB(0, 0, 0), 1: RGB(255, 0, 255)])
panels = Surface(facade_panels_2)
preview = CustomPreview(Geometry=panels, Material=gradient)

# ----
# WASTE CALCULATOR
area_2 = Area(Geometry=nesting.SheetRects)  # -> Area, Centroid
area_3 = Area(Geometry=nesting.Packed)  # -> Area, Centroid
ma_4 = MassAddition(Input=area_2.Area)  # -> Result, PartialResults
ma_5 = MassAddition(Input=area_3.Area)  # -> Result, PartialResults
panel_11 = Panel(ma_4.Result)
panel_12 = Panel(ma_5.Result)
subtraction = Subtraction(A=ma_4.Result, B=ma_5.Result)
mod = Modulus(A=ma_4.Result, B=subtraction)
panel_13 = Panel(mod)
dom = ConstructDomain(DomainStart="0", DomainEnd="100")
dom_2 = ConstructDomain(DomainStart="1", DomainEnd="0")
remap = RemapNumbers(Value=mod, Source=dom, Target=dom_2)  # -> Mapped, Clipped
clamp = Clamp(Value=remap.Mapped, Domain=dom_2)
panel_14 = Panel(clamp)
c_bake_2 = ContextBake(Waste_Reward=clamp)

# ----
# COST CALCULATOR
sheet = Curve(nesting.SheetRects)
len = Length(Curve=nesting.Packed)
area_4 = Area(Geometry=sheet)  # -> Area, Centroid
division_4 = Division(A=area_4.Area, B="100")
division_5 = Division(A=len, B="100")
fabrication_cost_per_m = Panel("30")
cost_per_m2 = Panel("30")
int = Integer(division_4)
multiplication = Multiplication(A=int, B=cost_per_m2)
multiplication_2 = Multiplication(A=division_5, B=fabrication_cost_per_m)  # -> flatten(Result)
ma_6 = MassAddition(Input=multiplication)  # -> Result, PartialResults
ma_7 = MassAddition(Input=multiplication_2)  # -> Result, PartialResults
addition = Addition(A=ma_6.Result, B=ma_7.Result)
total_cost = Panel(addition)
dom_3 = ConstructDomain(DomainStart=Slider(1500, range=300..1500), DomainEnd=Slider(4000, range=800..4000))
dom_4 = ConstructDomain(DomainStart="1", DomainEnd="0")
remap_2 = RemapNumbers(Value=addition, Source=dom_3, Target=dom_4)  # -> Mapped, Clipped
clamp_2 = Clamp(Value=remap_2.Mapped, Domain=dom_4)
panel_15 = Panel(clamp_2)
c_bake_3 = ContextBake(Paneling_Cost_Reward=clamp_2)

panel_16 = Panel(division_4)
